# Grasshopper definition PedSimFlowScript.gh (Grasshopper 1.0.7)
# plug-ins: PedSimulation, EleFront, Human

# ----
# Start Point(s)
panel = Panel("Start")

program = ProgramComponent(ProgramName="interest", DisplayColor=ColourSwatch(SwatchColor=RGB(255, 184, 97)))
# Visit Point(s)
reflay = ReferenceByLayer(LayerName="interest")
reflay_2 = ReferenceByLayer(LayerName=<missing>)
reflay_3 = ReferenceByLayer(LayerName=<missing>)

# ----
# End Point(s)
panel_2 = Panel("End")
reflay_4 = ReferenceByLayer(LayerName=panel_2)

reflay_5 = ReferenceByLayer(LayerName=<missing>)
pt = Point(<point referenced from the Rhino model>)
pt_2 = Point(<point referenced from the Rhino model>)
pt_3 = Point([<point referenced from the Rhino model> x10])
relay = Relay()
pill_tag = BooleanToggle(True)
pill_tag_2 = BooleanToggle(True)
pill_tag_3 = BooleanToggle(True)
gate = Gate(
    Position=pt_2,
    GateName="Start",
    ExitTime=Slider(0, range=0..1),
    AccessRadius=Slider(1, range=0..1),
    DrawDot=pill_tag_2,
    Color=ColourSwatch(SwatchColor=RGB(173, 56, 71)))
gate_2 = Gate(
    Position=pt,
    GateName="End",
    ExitTime=Slider(0, range=0..1),
    AccessRadius=Slider(1, range=0..1),
    DrawDot=pill_tag_3,
    Color=ColourSwatch(SwatchColor=RGB(126, 154, 247)))
target = Target(
    Position=pt_3,
    Program=program,
    VisitingTime=Slider(10, range=0..500),
    AccessRadius=Slider(2, range=0..10),
    DrawDot=pill_tag,
    createMultipleTargets=True)
crossref = CrossReference(ListA=gate, ListB=gate_2, CrossMode=1)  # -> ListA, ListB
body_width = Slider(0.55, range=0.3..0.95)
fanvision = FanShapedVision(Angle=149.994, Distance=50)

# ----
# Obstacle Curves
spawn_time = Slider(40, range=1..100, expression="x/4")

pt_4 = PersonTemplate(
    StartGate=crossref.ListA,
    DestinationGate=crossref.ListB,
    Interests=program,
    NeedValue=Slider(2, range=0..10),
    StartNumber=0,
    Probability=Slider(1, range=0..10),
    TimeLimit=-1,
    Vision=fanvision,
    BodyRadius=expr("x/2", body_width),
    TargetForce=20,
    DisplayColor=ColourSwatch(SwatchColor=RGB(252, 177, 97)),
    PersonTemplateDirectionMode=1)
pill_tag_4 = BooleanToggle(True)

# ----
# Reset Simulation
button = Button()

crv = Curve([<curve referenced from the Rhino model> x18])
cls = Closed(Curve=crv)  # -> Closed, Periodic
dispatch = Dispatch(List=crv, DispatchPattern=cls.Closed)  # -> ListA, ListB
crv_2 = Curve(dispatch.ListA)
panel_3 = Panel(crv)
settings = SystemSettings(
    FPS=30,
    ObstacleOffset=1,
    ObstacleRepulsionCoefA=50,
    ObstacleRepulsionCoefB=2,
    ObstacleRepulsionMax=5,
    ObstacleRepulsionThreshold=0.5,
    EnableTrace=pill_tag_4)

# ----
# Trigger
timer = Timer(Interval=100, TimerInterval=100, Target=pedsim)  # disabled

pedsim = PedSimulationSystem(
    Reset=button,
    PersonTemplates=pt_4,
    ObstacleCurves=crv_2,
    Population=Slider(10, range=0..20),
    Targets=target,
    GenerationTime=spawn_time,
    SystemSettings=settings)  # -> Out, People, GraphEdges, GraphVertices, GoalTagPositions, VisitCounts, PersonRecords
deconspr = DeconstructPersonRecord(PersonRecord=pedsim.PersonRecords)  # -> PersonID, TemplateID, StartTime, EndTime, TimeSequence, TracePositions, TraceSpeeds, StateSequence
line = Line(pedsim.GraphEdges)
material = CreateMaterial(
    Diffuse=ColourSwatch(SwatchColor=RGB(252, 177, 97)),
    Specular=RGB(255, 255, 255),
    Emission=RGB(0, 0, 0),
    Transparency=0,
    Shine=0)
pline = PolyLine(Vertices=deconspr.TracePositions, Closed=False)
deconsp = DeconstructPerson(Person=pedsim.People)  # -> ID, TemplateID, Position, BodyRadius, Velocity, Acceleration, CurrentPath, Behaviors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
drawperson = DrawPerson(People=pedsim.People, FOVMaterial=material, drawCurrentTargetFill=True, drawFOV=False, drawNumber=False)

# ----
# Preview Sightline
drawperson_2 = DrawPerson(People=pedsim.People, drawCurrentTargetFill=True, drawFOV=True, drawNumber=True)

lng = ListLength(List=pedsim.People)
series = Series(Start=0, Step=1, Count=Slider(125, range=0..150))
item = ListItem(List=flatten(pline), Index=series, Wrap=True)
split = SplitList(List=flatten(pline), Index=Slider(100, range=0..100))  # -> ListA, ListB
panel_4 = Panel(deconspr.TracePositions)
previewlw = CustomPreviewLineweights(Geometry=item, Shader=ColourSwatch(SwatchColor=RGB(255, 240, 77)), Absolute=False)

# ----
# Preview Points/Paths
pt_5 = Point(deconsp.Position)
crv_3 = Curve(deconsp.CurrentPath)

# ----
# Population In-Game
panel_5 = Panel(lng)

panel_6 = Panel(pline)
dots = DotDisplay(Point=pt_5, Colour=ColourSwatch(SwatchColor=RGB(33, 32, 31)), Size=Slider(0.3, range=0..1))
# Path
crv_4 = Curve([<curve referenced from the Rhino model> x100])
# Ground Surface
srf = Surface([<surface referenced from the Rhino model> x5])
cp = ControlPoints(Curve=crv_4)  # -> Points, Weights, Knots
Z = UnitZ(Factor=1)
project = ProjectPoint(Point=cp.Points, Direction=Z, Geometry=srf)  # -> Point, Index
Z_2 = UnitZ(Factor=Slider(1.6, range=0..10))
move = Move(Geometry=project.Point, Motion=Z_2)  # -> Geometry, Transform
pline_2 = PolyLine(Vertices=move.Geometry, Closed=False)
